# Grasshopper definition BSA_Contour Laser Cutter.gh (Grasshopper 1.0.7)
# plug-ins: OpenNest

# ---- group: Contour / Geometry Base
geometry = Geometry(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)

# ----
geometry_specify_object_to_form_contour = GetGeometry(
    geometry,
    AtLeast=1,
    AtMost=1,
    DeleteInput=False,
    Filter=1074004024,
    Prompt="Specify Object to form contours with (object must be in MM)")
float_material_thickness = GetNumber(
    Slider(5, range=1..10),
    AtLeast=1,
    AtMost=1,
    Maximum=50,
    Minimum=1,
    Prompt="Specify the Material Thickness for Laser Cut (default = 6mm)")

# ---- group: Contour
unit_z = UnitZ(Factor=1)
contour = Contour(Shape=geometry_specify_object_to_form_contour, Point=Point(0, 0, 0), Direction=unit_z, Distance=float_material_thickness)
data = Data(flatten(contour))
list_length = ListLength(List=data)
series = Series(Start=0, Step=float_material_thickness, Count=list_length)
unit_z_2 = UnitZ(Factor=1)
negative = Negative(Value=series)
amplitude = Amplitude(Vector=unit_z_2, Amplitude=negative)
move = Move(Geometry=flatten(contour), Motion=amplitude)  # -> Geometry, Transform

# ----
float_material_spacing = GetNumber(
    Slider(5, range=0..10),
    AtLeast=1,
    AtMost=1,
    Maximum=100,
    Minimum=0,
    Prompt="Specify Material Spacing within the Cutting Layout")
context_bake = ContextBake(Geometry=contour)

# ---- group: FOR FABRICATION
geometry_2 = Geometry(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)

# ----
curve_specify_board_cutting_size = GetGeometry(
    geometry_2,
    AtLeast=1,
    AtMost=1,
    DeleteInput=False,
    Filter=1073741828,
    Prompt="Specify the (Curve) Board size where the cutting will be laid upon")

# ---- group: FOR FABRICATION (continued)
opennest = OpenNest(
    Sheets=curve_specify_board_cutting_size,
    Geo=move.Geometry,
    Spacing=float_material_spacing,
    Placement=1,
    Tolerance=0.1,
    Rotations=4,
    Iterations=1,
    Seed=Slider(1, range=0..10),
    Reset=True,
    Run=Toggle(True))  # -> Sheets, Geo, ID, Transform, IDS

# ----
context_print = ContextPrint(Text=opennest.ID)
context_bake_2 = ContextBake(Geometry=opennest.Geo)
context_bake_3 = ContextBake(Geometry=opennest.Sheets)
